# Grasshopper definition 从点云生成地形2.gh (Grasshopper 1.0.7)
# plug-ins: LunchBox, Bifocals

# ----
# 单位：米
# 请去Rhino中统一单位
# 所有操作单元都在结尾处
# 保存时请确认关闭此按钮
# Make sure to save as "False"
boolean_toggle = BooleanToggle(False)

# ----
# 请打开Excel，确认与表头保持一致
# 1、指定Excel表的文件路径
panel = Panel("高程点17-51-44")
file_path = FilePath("J:\设计\LAC\彝青\高程点17-51-44.csv")
excel_reader = ExcelReader(ReadExcelData=boolean_toggle, WorkbookPath=file_path, WorksheetName=panel)  # -> Exceptions, ExcelData
cull_index = CullIndex(List=excel_reader.ExcelData, Indices="0", Wrap=True)

# ---- group: 使用少量样本进行实验
construct_domain = ConstructDomain(DomainStart="0", DomainEnd="10000")
sub_list = SubList(List=cull_index, Domain=construct_domain, Wrap=True)  # -> List, Index

# ----
比例尺的倒数_严谨 = Panel("100000")
explode_tree = ExplodeTree(Data=cull_index)  # -> Branch0, Branch1, Branch2
multiplication = Multiplication(A=explode_tree.Branch0, B=比例尺的倒数_严谨)
multiplication_2 = Multiplication(A=explode_tree.Branch1, B=比例尺的倒数_严谨)
construct_point = ConstructPoint(XCoordinate=multiplication, YCoordinate=multiplication_2, ZCoordinate=explode_tree.Branch2)
sort_points = SortPoints(Points=construct_point)  # -> Points, Indices

# ---- group: 移动点云至原点附近
list_item = ListItem(List=sort_points.Points, Index="0", Wrap=True)
vector_2pt = Vector2Pt(PointA=list_item, PointB="0,0,0", Unitize=False)  # -> Vector, Length
# 生成mesh不会卡特别长时间，请尽可能关闭其他所有程序后，连接这两个模块
move = Move(Geometry=sort_points.Points, Motion=vector_2pt.Vector)  # -> Geometry, Transform

# ---- group: 生成mesh
delaunay_mesh = DelaunayMesh(Plane=PlaneXY(0, 0, 0))
weld_mesh = WeldMesh(Mesh=delaunay_mesh, Angle=3.141592654)
smooth_mesh = SmoothMesh(Mesh=weld_mesh, Strength=0.5, SkipNaked=True, Iterations=1)

# ---- group: 分段生成nurbs曲面 / 分步运算器（对自己和电脑都好一点）
trigger = Trigger(Interval=1000, TimerInterval=1000, Target=data_recorder)  # disabled
panel_2 = Panel("10")
# 3、单击X
# 4、单击○
# 5、单击▷
# 一定要按顺序！！！
data_recorder = DataRecorder(panel_2, DataLimit=80, RecordData=False)
mass_addition = MassAddition(Input=data_recorder)  # -> Result, PartialResults

# ---- group: 分段生成nurbs曲面
point = Point(move.Geometry)
deconstruct = Deconstruct(Point=point)  # -> XComponent, YComponent, ZComponent
construct_point_2 = ConstructPoint(XCoordinate=deconstruct.XComponent, YCoordinate=deconstruct.YComponent, ZCoordinate="0")
interpolate = Interpolate(Vertices=construct_point_2, Degree=1, Periodic=False, KnotStyle=1)  # -> Curve, Length, Domain
discontinuity = Discontinuity(Curve=interpolate.Curve, Level=1)  # -> Points, Parameters
point_order = PointOrder(Points=construct_point_2)
point_list = PointList(Points=construct_point_2, Size="2")
create_set = CreateSet(List=discontinuity.Points)  # -> Set, Map
member_index = MemberIndex(Set=construct_point_2, Member=create_set.Set)  # -> flatten(Index), Count
list_length = ListLength(List=member_index.Index)
series = Series(Start=0, Step=1, Count=list_length)
consecutive_domains = ConsecutiveDomains(Numbers=series, Additive=Toggle(False))
series_2 = Series(Start="1", Step="2", Count=list_length)
series_3 = Series(Start=0, Step=1, Count=10)
cull_index_2 = CullIndex(List=consecutive_domains, Indices=series_2, Wrap=Toggle(False))
sub_list_2 = SubList(List=member_index.Index, Domain=cull_index_2, Wrap=True)  # -> List, Index
negative = Negative(Value=panel_2)
consecutive_domains_2 = ConsecutiveDomains(Numbers=sub_list_2.List, Additive=Toggle(False))
addition = Addition(A=panel_2, B="1")
sub_list_3 = SubList(List=point, Domain=consecutive_domains_2, Wrap=True)  # -> simplify(List), Index
addition_2 = Addition(A=mass_addition.Result, B=negative)
series_4 = Series(Start=addition_2, Step=1, Count=addition)
list_length_2 = ListLength(List=sub_list_3.List)
tree_branch = TreeBranch(Tree=sub_list_3.List, Path=series_4, MaintainPaths=True)
panel_3 = Panel(addition_2)
interpolate_2 = Interpolate(Vertices=tree_branch, Degree=5, Periodic=False, KnotStyle=0)  # -> Curve, Length, Domain
# 结束运行时，请依次反向操作
panel_4 = Panel(series_4)
param_viewer = ParamViewer(tree_branch)
loft_options = LoftOptions(Closed=False, Adjust=True, Rebuild=0, Refit=0, Type=0)
loft = Loft(Curves=flatten(interpolate_2.Curve), Options=loft_options)
# 2、双击改为true
boolean_toggle_2 = BooleanToggle(False)
object_bake = ObjectBake(
    BakeToggle=boolean_toggle_2,
    GeometryObjects=loft,
    Layer="地形",
    ObjectName="GH_Obj",
    ObjectColor=ColourSwatch(SwatchColor=RGBA(131, 192, 201, 151)),
    LayerColor=RGB(255, 255, 255))
